# Dynamo graph Danh STT.dyn (Dynamo 2.16.4.10216)
# packages: Genius Loci 2023.7.13, RIE 2021.7.3

family_types = FamilyTypes("MC Void Provision Rectangular Horizontal:DP - Lukningstype VL-1.2")  # frozen
family = FamilyType.Family(familyType=family_types)
all_elements_of_family = Custom[All Elements of Family](family=family)  # package Genius Loci; Get the family instances of the given loadable family.
family_types_2 = FamilyTypes("MC Void Provision Round Horizontal:DP - Lukningstype VL-1.1")  # frozen
family_2 = FamilyType.Family(familyType=family_types_2)
all_elements_of_family_2 = Custom[All Elements of Family](family=family_2)
join = List.Join(list0=all_elements_of_family, list1=all_elements_of_family_2)
categories = Categories("OST_MechanicalEquipment")
code_block = CodeBlock { true; }
RIE_ActiveView = Custom[RIE_ActiveView](Refresh=code_block)  # package RIE; Returns active view in current document.
all_elements_of_category_in_view = ElementsOfCategoryInView(Category=categories, View=RIE_ActiveView)
code_block_2 = CodeBlock(e=all_elements_of_category_in_view) { e.Name; }
code_block_3 = CodeBlock { "DP - Lukningstype"; }
startsWith = String.StartsWith(string=code_block_2, searchFor=code_block_3)
filterByBoolMask = List.FilterByBoolMask(list=all_elements_of_category_in_view, mask=startsWith)
code_block_4 = CodeBlock(a=filterByBoolMask.in) { a; }
id = Element.Id()  # unwired: element
sortByFunction = List.SortByFunction(list=code_block_4, sortFunction=id)
code_block_5 = CodeBlock { "DP Pos."; }

# group: Run index
string = StringInput("E01.")
length = String.Length(string=string)
code_block_6 = CodeBlock(a=length) { 3+a; }
count = List.Count(list=sortByFunction)
code_block_7 = CodeBlock(a=count) { 1..a; }
string_from_object = FromObject(object=code_block_7)
code_block_8 = CodeBlock { 3; }
string_2 = StringInput("0")
padLeft = String.PadLeft(string=string_from_object, newLength=code_block_8, padChars=string_2)
padRight = String.PadRight(string=string, newLength=code_block_6, padChars=padLeft)

setParameterByName = Element.SetParameterByName(element=sortByFunction, parameterName=code_block_5, value=padRight)
location = FamilyInstance.Location()  # unwired: familyInstance
