# Dynamo graph F4 Duct.dyn (Dynamo 2.16.4.10216)
# packages: MEPover 2022.10.30, RIE 2021.7.3, MEPover 2024.9.25, GenerativeDesign 3.0.18.0, Universo_BIM 19.10.11

# group: Select start element
resetData = BoolSelector(true)  # graph input
select_model_element = DSModelElementSelection()  # 1 picked in the model; graph input
reset_data = Gate(true, select_model_element)  # graph output
reset_data_2 = Gate(false, select_model_element)  # graph output
if_ = RefactoredIf(test=resetData, true=reset_data, false=reset_data_2)
code_block = CodeBlock(a=if_) { a; }

# group: Append start element to the list (it will be the index 0 element)
code_block_2 = CodeBlock { false; }
elements_in_connected_network = Custom[Elements in connected network](element=code_block, IncludeInputElement=code_block_2)  # package MEPover; Returns all elements that are physically connected to the input element
join = List.Join(list0=code_block, list1=elements_in_connected_network)

# group: Filter Union
code_block_3 = CodeBlock(e=join) { e.Name; }
code_block_4 = CodeBlock { "magirect_joint1_"; }
startsWith = String.StartsWith(string=code_block_3, searchFor=code_block_4)
filterByBoolMask = List.FilterByBoolMask(list=join, mask=startsWith)

categoryName = Elements.Element.CategoryName(element=filterByBoolMask.out)

# group: Filter Duct Insu, Duct Fittings, Duct Accessories
filter_ductsinsulation = Python(IN[0]=categoryName)  # IronPython2
# ---------- filter_ductsinsulation.python (18 lines) ----------
# Load the Python Standard and DesignScript Libraries
import sys
import clr
clr.AddReference('ProtoGeometry')
from Autodesk.DesignScript.Geometry import *

# The inputs to this node will be stored as a list in the IN variables.
elements = IN[0]
result = []

for e in elements:
    if e == "Duct Insulations":
        result.append(True)
    else:
        result.append(False)

# Assign your output to the OUT variable.
OUT = result
# ----------------------------------------
filterByBoolMask_2 = List.FilterByBoolMask(list=filterByBoolMask.out, mask=filter_ductsinsulation)
filter_ducts = Python(IN[0]=categoryName)  # IronPython2
# ---------- filter_ducts.python (18 lines) ----------
# Load the Python Standard and DesignScript Libraries
import sys
import clr
clr.AddReference('ProtoGeometry')
from Autodesk.DesignScript.Geometry import *

# The inputs to this node will be stored as a list in the IN variables.
elements = IN[0]
result = []

for e in elements:
    if e == "Ducts":
        result.append(True)
    else:
        result.append(False)

# Assign your output to the OUT variable.
OUT = result
# ----------------------------------------
filter_ducts_fittings = Python(IN[0]=categoryName)  # IronPython2
# ---------- filter_ducts_fittings.python (18 lines) ----------
# Load the Python Standard and DesignScript Libraries
import sys
import clr
clr.AddReference('ProtoGeometry')
from Autodesk.DesignScript.Geometry import *

# The inputs to this node will be stored as a list in the IN variables.
elements = IN[0]
result = []

for e in elements:
    if e == "Duct Fittings":
        result.append(True)
    else:
        result.append(False)

# Assign your output to the OUT variable.
OUT = result
# ----------------------------------------

# group: Choose Ducts or Duct Fittings
ducts_or_duct_fittings = BoolSelector(false)  # graph input
if_2 = RefactoredIf(test=ducts_or_duct_fittings, true=filter_ducts, false=filter_ducts_fittings)
filterByBoolMask_3 = List.FilterByBoolMask(list=filterByBoolMask.out, mask=if_2)
elements = CodeBlock(a=filterByBoolMask_3.in) { a; }

# group: Filter Rectangular Duct
RIE_GetElementConnector = Custom[RIE_GetElementConnector](Elements=elements)  # package RIE
shape = Custom[Connector.Shape](connector=RIE_GetElementConnector)  # package MEPover; Returns the shape of the connector
flatten = List.Flatten(list=shape@L3)
RIE_RemoveNulls = Custom[RIE_RemoveNulls](list=flatten@L2)  # package RIE; Removes Nulls from list, and outputs a clean list as well as a list of indices that contained nulls in input list
code_block_5 = CodeBlock(a=RIE_RemoveNulls.CleanList) { a; }
string_from_object = FromObject(object=code_block_5)
code_block_6 = CodeBlock { "Rectangular"; }
eq = string_from_object == code_block_6
anyTrue = List.AnyTrue(list=eq@L2)
filterByBoolMask_4 = List.FilterByBoolMask(list=elements, mask=anyTrue)

# group: Filter DP Pos has 1 or 2 pad
code_block_7 = CodeBlock(q=filterByBoolMask_4.in) { q; }
code_block_8 = CodeBlock { "DP Pos."; }
getParameterValueByName = Element.GetParameterValueByName(element=code_block_7, parameterName=code_block_8)
length = String.Length(string=getParameterValueByName)
string_from_object_2 = FromObject(object=length)
filter_1_2 = Python(IN[0]=string_from_object_2)  # IronPython2
# ---------- filter_1_2.python (18 lines) ----------
# Load the Python Standard and DesignScript Libraries
import sys
import clr
clr.AddReference('ProtoGeometry')
from Autodesk.DesignScript.Geometry import *

# The inputs to this node will be stored as a list in the IN variables.
elements = IN[0]
result = []

for e in elements:
    if e == "1" or e=="2":
        result.append(True)
    else:
        result.append(False)

# Assign your output to the OUT variable.
OUT = result
# ----------------------------------------
filterByBoolMask_5 = List.FilterByBoolMask(list=code_block_7, mask=filter_1_2)

# group: OPTION
transfer = Gate(true, filterByBoolMask_5.out)
transfer_2 = Gate(false, filterByBoolMask_5.out)
if_3 = RefactoredIf(test=ducts_or_duct_fittings, true=transfer, false=transfer_2)
ducts = CodeBlock(a=if_3) { a; }
transfer_3 = Gate(false, filterByBoolMask_5.out)
transfer_4 = Gate(true, filterByBoolMask_5.out)
if_4 = RefactoredIf(test=ducts_or_duct_fittings, true=transfer_3, false=transfer_4)
duct_accesories = CodeBlock(a=if_4) { a; }

# group: Group Size and Lenght
code_block_9 = CodeBlock { "Width"; }
getParameterValueByName_2 = Element.GetParameterValueByName(element=ducts, parameterName=code_block_9)
round = Math.Round(number=getParameterValueByName_2)
code_block_10 = CodeBlock { "Height"; }
getParameterValueByName_3 = Element.GetParameterValueByName(element=ducts, parameterName=code_block_10)
round_2 = Math.Round(number=getParameterValueByName_3)
code_block_11 = CodeBlock(a=round, b=round_2) { a>=b ? a + "x" + b : b + "x" + a; }
groupByKey = List.GroupByKey(list=ducts, keys=code_block_11)
code_block_12 = CodeBlock(a=groupByKey.uniqueKeys) { a; }
code_block_13 = CodeBlock(a=groupByKey.groups) { a; }
code_block_14 = CodeBlock { "Length"; }
getParameterValueByName_4 = Element.GetParameterValueByName(element=code_block_13, parameterName=code_block_14)
code_block_15 = CodeBlock { 1; }
round_3 = Math.Round(number=getParameterValueByName_4, digits=code_block_15)
groupByKey_2 = List.GroupByKey(list=code_block_13@L2, keys=round_3@L2)
code_block_16 = CodeBlock(a=groupByKey_2.groups) { a; }

# group: System Code
system_code = StringInput("17")  # graph input
index = CodeBlock(a=system_code) { a; }
index_2 = CodeBlock(a=system_code) { a; }

# group: Run from 1 or Run from Index
run_from_1_or_run_from_index = BoolSelector(true)  # graph input
index_edit_if_you_choose_not = DoubleInput(0)  # "Index (edit if you choose not start from 1)"; graph input

# group: Run index for Ducts
code_block_17 = CodeBlock { 2; }
length_2 = String.Length(string=index)
code_block_18 = CodeBlock(length=code_block_17, a=length_2) { length+a; }
count = List.Count(list=code_block_16@L2)
count_2 = List.Count(list=count@L2)
code_block_19 = CodeBlock(x=index_edit_if_you_choose_not, a=count_2) { x..x+a; }
string = StringInput("0")
code_block_20 = CodeBlock { 0; }
code_block_21 = CodeBlock { 99; }
code_block_22 = CodeBlock { 3; }
code_block_23 = CodeBlock(length=code_block_22, a=length_2) { length+a; }
string_2 = StringInput("0")
code_block_24 = CodeBlock { 99; }
flatten_2 = List.Flatten(list=code_block_16@L2)

# group: Run index for Ducts > Can edit here
code_block_25 = CodeBlock(a=count_2) { 1..a; }

# group (continued): Run index for Ducts
if_5 = RefactoredIf(test=run_from_1_or_run_from_index, true=code_block_25, false=code_block_19)
string_from_object_3 = FromObject(object=if_5)
padLeft = String.PadLeft(string=string_from_object_3, newLength=code_block_17, padChars=string)
padRight = String.PadRight(string=index, newLength=code_block_18, padChars=padLeft)
slice = List.Slice(list=padRight, start=code_block_20, end=code_block_21)
padLeft_2 = String.PadLeft(string=string_from_object_3, newLength=code_block_22, padChars=string_2)
padRight_2 = String.PadRight(string=index, newLength=code_block_23, padChars=padLeft_2)
count_3 = List.Count(list=padRight_2)
code_block_26 = CodeBlock(a=count_3) { a; }
slice_2 = List.Slice(list=padRight_2, start=code_block_24, end=code_block_26)
join_2 = List.Join(list0=slice, list1=slice_2)
flatten_3 = List.Flatten(list=join_2)

# group: Action
code_block_27 = CodeBlock { "DP Pos."; }
setParameterByName = Element.SetParameterByName(element=flatten_2@L3, parameterName=code_block_27, value=join_2@L2)

# group: Run index for Duct Accesories
code_block_28 = CodeBlock { 2; }
length_3 = String.Length(string=index_2)
code_block_29 = CodeBlock(length=code_block_28, a=length_3) { length+a; }
count_4 = List.Count(list=duct_accesories)
code_block_30 = CodeBlock(x=index_edit_if_you_choose_not, a=count_4) { x..x+a; }
string_3 = StringInput("0")
code_block_31 = CodeBlock { 0; }
code_block_32 = CodeBlock { 99; }
code_block_33 = CodeBlock { 3; }
code_block_34 = CodeBlock(length=code_block_33, a=length_3) { length+a; }
string_4 = StringInput("0")
code_block_35 = CodeBlock { 99; }

# group: Run index for Duct Accesories > Can edit here
code_block_36 = CodeBlock(a=count_4) { 1..a; }

# group (continued): Run index for Duct Accesories
if_6 = RefactoredIf(test=run_from_1_or_run_from_index, true=code_block_36, false=code_block_30)
string_from_object_4 = FromObject(object=if_6)
padLeft_3 = String.PadLeft(string=string_from_object_4, newLength=code_block_28, padChars=string_3)
padRight_3 = String.PadRight(string=index_2, newLength=code_block_29, padChars=padLeft_3)
slice_3 = List.Slice(list=padRight_3, start=code_block_31, end=code_block_32)
padLeft_4 = String.PadLeft(string=string_from_object_4, newLength=code_block_33, padChars=string_4)
padRight_4 = String.PadRight(string=index_2, newLength=code_block_34, padChars=padLeft_4)
count_5 = List.Count(list=padRight_4)
code_block_37 = CodeBlock(a=count_5) { a; }
slice_4 = List.Slice(list=padRight_4, start=code_block_35, end=code_block_37)
join_3 = List.Join(list0=slice_3, list1=slice_4)

# group: Action
code_block_38 = CodeBlock { "DP Pos."; }
setParameterByName_2 = Element.SetParameterByName(element=duct_accesories, parameterName=code_block_38, value=join_3)
