# Dynamo graph Get Ceilings Curve.dyn (Dynamo 2.16.4.10216)
# packages: Genius Loci 2023.7.13, Sparrow 2021.2.1, Clockwork for Dynamo 2.x 2.12.2, Genius Loci 2024.5.29

select_model_elements_by = DSModelElementsByCategorySelection("OST_Ceilings")  # "Select Model Elements By Category"; 1 picked in the model
code_block = CodeBlock(a=select_model_elements_by) { a; }
code_block_2 = CodeBlock { null; }
getGridCurves = Sparrow.Revit.Ceilings.GetGridCurves(ceiling=code_block, LinkInstance=code_block_2)
compound_edges_references = Custom[Compound Edges References](element=code_block)  # package Genius Loci; Get the vertical edges and their references of the roof, floor, ceiling or wall. Also works with linked element.
code_block_3 = CodeBlock(a=compound_edges_references.Horizontal_Edges) { a; }
direction = Line.Direction(line=code_block_3)
firstItem = List.FirstItem(list=direction)
direction_2 = Line.Direction(line=code_block_3)
isParallel = Vector.IsParallel(vector=firstItem, otherVector=direction_2)
filterByBoolMask = List.FilterByBoolMask(list=code_block_3, mask=isParallel)
code_block_4 = CodeBlock(b=filterByBoolMask.out) { b; }
length = Curve.Length(curve=code_block_4)
python_script = Python(IN[0]=length)  # CPython3
# ---------- python_script.python (26 lines) ----------
# Load the Python Standard and DesignScript Libraries
import sys
import clr
clr.AddReference('ProtoGeometry')
from Autodesk.DesignScript.Geometry import *

# The inputs to this node will be stored as a list in the IN variables.
lstCheck = IN[0]  # Danh sách đầu vào cần kiểm tra

# Kiểm tra nếu danh sách không rỗng
result = []
if lstCheck and isinstance(lstCheck, list):
    max_value = max(lstCheck)  # Tìm giá trị lớn nhất trong danh sách
    found_max = False  # Cờ đánh dấu khi đã gặp giá trị lớn nhất đầu tiên
    
    for x in lstCheck:
        if not found_max and x == max_value:
            result.append(True)  # Đánh dấu True cho giá trị lớn nhất đầu tiên
            found_max = True  # Cập nhật cờ
        else:
            result.append(False)  # Các giá trị khác là False
else:
    result = []  # Trả về danh sách rỗng nếu đầu vào không hợp lệ

# Assign your output to the OUT variable.
OUT = result
# ----------------------------------------
filterByBoolMask_2 = List.FilterByBoolMask(list=code_block_4, mask=python_script)
code_block_5 = CodeBlock(a=filterByBoolMask_2.in) { a; }
length_2 = Curve.Length(curve=code_block_5)
compound_pattern_reference = Custom[Compound Pattern Reference](element=code_block)  # package Genius Loci; Retrieves Surface, Material, Fill Pattern and its references of a roof, floor, ceiling or wall. These references can then be used to dimension the FillPattern. Also works with linked element.
code_block_6 = CodeBlock(a=compound_pattern_reference.FillPatternElement) { a; }
fill_pattern_properties = Custom[Fill Pattern Properties](fillPatternElement=code_block_6)  # package Genius Loci; Returns the target, orientation, angles, origins, shifts, offsets, dashes and spaces of a given fill pattern.
code_block_7 = CodeBlock(a=fill_pattern_properties.Offsets) { a; }
code_block_8 = CodeBlock(a=code_block_7) { a[0]; }
code_block_9 = CodeBlock(length=length_2, Step=code_block_8) { length/Step; }
n = Math.Floor(number=code_block_9)
isEvenNumber = Custom[IsEvenNumber](val=n)  # package Clockwork for Dynamo 2.x; Checks if a number is even.
code_block_10 = CodeBlock { 0; }
code_block_11 = CodeBlock { 1; }
if_ = RefactoredIf(test=isEvenNumber, true=code_block_10, false=code_block_11)
r = CodeBlock(L=length_2, n=n, z=if_, step=code_block_8) { (L - (n-z)*step)/2; }
points = CodeBlock(r=r, L=length, step=code_block_8) { r..L..step; }
pointAtSegmentLength = Curve.PointAtSegmentLength(curve=code_block_5, segmentLength=points)
flatten = List.Flatten(list=pointAtSegmentLength)
X = Point.X(point=flatten)
abs = Math.Abs(number=X)
ceiling = Math.Ceiling(number=abs)
python_script_2 = Python(IN[0]=ceiling)  # CPython3
# ---------- python_script_2.python (17 lines) ----------
# Đầu vào từ Dynamo
input_list = IN[0]  # Danh sách cần kiểm tra

# Hàm kiểm tra tất cả các phần tử trong danh sách có bằng nhau hay không
def all_elements_equal(lst):
    if len(lst) == 0:
        return False  # Danh sách rỗng trả về False
    return all(x == lst[0] for x in lst)

# Thực thi hàm
if isinstance(input_list, list):
    result = all_elements_equal(input_list)
else:
    result = False  # Nếu không phải danh sách, trả về False

# Đầu ra tới Dynamo
OUT = result
# ----------------------------------------
Y = Point.Y()  # unwired: point
X_2 = Point.X()  # unwired: point
if_2 = RefactoredIf(test=python_script_2, true=Y, false=X_2)
sortByFunction = List.SortByFunction(list=flatten, sortFunction=if_2)
code_block_12 = CodeBlock(a=filterByBoolMask_2.out) { a; }
direction_3 = Line.Direction(line=code_block_5)
ZAxis = Vector.ZAxis()
cross = Vector.Cross(vector=direction_3, cross=ZAxis)
project = Point.Project(point=pointAtSegmentLength@L2, baseGeometry=code_block_12, projectionDirection=cross, lacing=Longest)
list_clean = Custom[List Clean](list=project)  # package Genius Loci; Removes all Null, Empty and Blank from a list or nested list of lists.
flatten_2 = List.Flatten(list=list_clean)
X_3 = Point.X(point=flatten_2)
abs_2 = Math.Abs(number=X_3)
ceiling_2 = Math.Ceiling(number=abs_2)
python_script_3 = Python(IN[0]=ceiling_2)  # CPython3; same code as python_script_2
Y_2 = Point.Y()  # unwired: point
X_4 = Point.X()  # unwired: point
if_3 = RefactoredIf(test=python_script_3, true=Y_2, false=X_4)
sortByFunction_2 = List.SortByFunction(list=flatten_2, sortFunction=if_3)
byStartPointEndPoint = Line.ByStartPointEndPoint(startPoint=sortByFunction, endPoint=sortByFunction_2)
code_block_13 = CodeBlock(a=filterByBoolMask.in) { a; }
length_3 = Curve.Length(curve=code_block_13)
python_script_4 = Python(IN[0]=length_3)  # CPython3; same code as python_script
filterByBoolMask_3 = List.FilterByBoolMask(list=code_block_13, mask=python_script_4)
code_block_14 = CodeBlock(a=filterByBoolMask_3.in) { a; }
length_4 = Curve.Length(curve=code_block_14)
code_block_15 = CodeBlock(a=code_block_7) { a[1]; }
code_block_16 = CodeBlock(l=length_4, st=code_block_15) { l%st; }
code_block_17 = CodeBlock(length=length_4, Step=code_block_15) { length/Step; }
n_2 = Math.Floor(number=code_block_17)
isEvenNumber_2 = Custom[IsEvenNumber](val=n_2)
code_block_18 = CodeBlock { 0; }
code_block_19 = CodeBlock { 1; }
if_4 = RefactoredIf(test=isEvenNumber_2, true=code_block_18, false=code_block_19)
r_2 = CodeBlock(L=length_4, n=n_2, z=if_4, step=code_block_15) { (L - (n-z)*step)/2; }
points_2 = CodeBlock(r=r_2, L=length_3, step=code_block_15) { r..L..step; }
pointAtSegmentLength_2 = Curve.PointAtSegmentLength(curve=code_block_14, segmentLength=points_2)
flatten_3 = List.Flatten(list=pointAtSegmentLength_2)
X_5 = Point.X(point=flatten_3)
abs_3 = Math.Abs(number=X_5)
ceiling_3 = Math.Ceiling(number=abs_3)
python_script_5 = Python(IN[0]=ceiling_3)  # CPython3; same code as python_script_2
Y_3 = Point.Y()  # unwired: point
X_6 = Point.X()  # unwired: point
if_5 = RefactoredIf(test=python_script_5, true=Y_3, false=X_6)
sortByFunction_3 = List.SortByFunction(list=flatten_3, sortFunction=if_5)
code_block_20 = CodeBlock(a=filterByBoolMask_3.out) { a; }
direction_4 = Line.Direction(line=code_block_14)
ZAxis_2 = Vector.ZAxis()
cross_2 = Vector.Cross(vector=direction_4, cross=ZAxis_2)
project_2 = Point.Project(point=pointAtSegmentLength_2@L2, baseGeometry=code_block_20, projectionDirection=cross_2, lacing=Longest)
list_clean_2 = Custom[List Clean](list=project_2)
flatten_4 = List.Flatten(list=list_clean_2)
X_7 = Point.X(point=flatten_4)
abs_4 = Math.Abs(number=X_7)
ceiling_4 = Math.Ceiling(number=abs_4)
python_script_6 = Python(IN[0]=ceiling_4)  # CPython3; same code as python_script_2
Y_4 = Point.Y()  # unwired: point
X_8 = Point.X()  # unwired: point
if_6 = RefactoredIf(test=python_script_6, true=Y_4, false=X_8)
sortByFunction_4 = List.SortByFunction(list=flatten_4, sortFunction=if_6)
byStartPointEndPoint_2 = Line.ByStartPointEndPoint(startPoint=sortByFunction_3, endPoint=sortByFunction_4)
