# Dynamo graph Get PipeSystemType.dyn (Dynamo 2.16.2.5624)

python_script = Python()  # IronPython2; unwired: IN[0]
# ---------- python_script.python (39 lines) ----------
import clr
import System
import math
from System.Collections.Generic import *

clr.AddReference("ProtoGeometry")
from Autodesk.DesignScript.Geometry import *

clr.AddReference('RevitAPI')
import Autodesk
from Autodesk.Revit.DB import *

clr.AddReference('RevitAPIUI')
from Autodesk.Revit.UI import *
from Autodesk.Revit.UI.Selection import *

clr.AddReference("RevitNodes")
import Revit

clr.ImportExtensions(Revit.Elements)
clr.ImportExtensions(Revit.GeometryConversion)

clr.AddReference("RevitServices")
import RevitServices
from RevitServices.Persistence import DocumentManager
from RevitServices.Transactions import TransactionManager

doc = DocumentManager.Instance.CurrentDBDocument
view = doc.ActiveView
uidoc = DocumentManager.Instance.CurrentUIApplication.ActiveUIDocument

"""--------------------------Main Code--------------------------"""
# Lấy danh sách tất cả Pipe System Types trong dự án
pipeSystem = list(FilteredElementCollector(doc).OfCategory(BuiltInCategory.OST_PipingSystem).WhereElementIsElementType())

pipeSystemName = [ps.LookupParameter("Type Name").AsValueString() for ps in pipeSystem]

# Xuất danh sách tất cả Pipe System Types
OUT = dict(zip(pipeSystemName,pipeSystem))
# ----------------------------------------
type = Object.Type(object=python_script)
values = DesignScript.Builtin.Dictionary.Values(dictionary=python_script)
watch = Watch(values)
keys = DesignScript.Builtin.Dictionary.Keys(dictionary=python_script)
watch_2 = Watch(keys)
