# Dynamo graph SquareCentrePoint.dyn (Dynamo 2.16.4.10216)

integer_slider = IntegerSlider(18, range=10..50 step 2)  # graph input
byWidthLength = Rectangle.ByWidthLength(width=integer_slider, length=integer_slider)
byPatch = Surface.ByPatch(closedCurve=byWidthLength)
perimeterCurves = Surface.PerimeterCurves(surface=byPatch)
code_block = CodeBlock { 0..1..#6; }
pointAtParameter = Curve.PointAtParameter(curve=perimeterCurves@L1, param=code_block)
code_block_2 = CodeBlock(a=pointAtParameter, b=pointAtParameter, c=pointAtParameter, d=pointAtParameter) { a[0]; b[1]; c[2]; d[3]; }
reverse = List.Reverse(list=code_block_2.out2)
byStartPointEndPoint = Line.ByStartPointEndPoint(startPoint=code_block_2.out0, endPoint=reverse)
reverse_2 = List.Reverse(list=code_block_2.out3)
byStartPointEndPoint_2 = Line.ByStartPointEndPoint(startPoint=code_block_2.out1, endPoint=reverse_2)
intersect = Geometry.Intersect(geometry=byStartPointEndPoint, other=byStartPointEndPoint_2, lacing=CrossProduct)
X = Point.X(point=intersect)
code_block_3 = CodeBlock(a=intersect) { a[0][0]; }
code_block_4 = CodeBlock(a=intersect) { a[0][1]; }
distanceTo = Geometry.DistanceTo(geometry=code_block_3, other=code_block_4)
code_block_5 = CodeBlock(b=distanceTo) { b/2; }
code_block_6 = CodeBlock(n=code_block_5) { n[0]; }
code_block_7 = CodeBlock(x=X, n=code_block_6) { x-n; }
Y = Point.Y(point=intersect)
code_block_8 = CodeBlock(y=Y, n=code_block_6) { y-n; }
Z = Point.Z(point=intersect)
byCoordinates = Point.ByCoordinates(x=code_block_7, y=code_block_8, z=Z)
code_block_9 = CodeBlock { 0; }
removeItemAtIndex = List.RemoveItemAtIndex(list=byCoordinates@L4, indices=code_block_9)
code_block_10 = CodeBlock { 5; }
removeItemAtIndex_2 = List.RemoveItemAtIndex(list=removeItemAtIndex@L3, indices=code_block_10)
