# Dynamo graph Tìm size duct fitting R1.dyn (Dynamo 2.16.1.2727)

select_model_elements_by = DSModelElementsByCategorySelection("OST_DuctFitting")  # "Select Model Elements By Category"; 6 picked in the model
filter1 = Python(IN[0]=select_model_elements_by)  # IronPython2
# ---------- filter1.python (57 lines) ----------
import clr
import math

clr.AddReference('RevitAPI')
from Autodesk.Revit.DB import *

clr.AddReference('RevitAPIUI')
from Autodesk.Revit.UI import *

clr.AddReference('System')
from System.Collections.Generic import List

clr.AddReference('RevitNodes')
import Revit
clr.ImportExtensions(Revit.GeometryConversion)
clr.ImportExtensions(Revit.Elements)

clr.AddReference('RevitServices')
import RevitServices
from RevitServices.Persistence import DocumentManager
from RevitServices.Transactions import TransactionManager

doc = DocumentManager.Instance.CurrentDBDocument
uidoc = DocumentManager.Instance.CurrentUIApplication.ActiveUIDocument


def is_round_bending(fitting_type):
    for round_bending_name in round_bending_names:
        if round_bending_name in fitting_type:
            return True
    return False

def is_round_tee(fitting_type):
    for round_tee_name in round_tee_names:
        if round_tee_name in fitting_type:
            return True
    return False

def is_round_transition(fitting_type):
    for round_transition_name in round_transition_names:
        if round_transition_name in fitting_type:
            return True
    return False

elements = IN[0]
round_bending_names = ["BU:BU","BKU:BKU","BFU:BFU","BKFU:BKFU"]
round_tee_names = ["TCPU:TCPU","TCU:TCU"]
round_transition_names = ["RCLU:RCLU","RCU:RCU"]


element_s = []

for i,element in enumerate(elements):
    fitting_type = element.GetParameterValueByName("ObjectTypeOverride")
    if is_round_bending(fitting_type) or is_round_tee(fitting_type) or is_round_transition(fitting_type) or "ILRU:ILRU" in fitting_type:
    	element_s.append(element)
OUT = element_s
# ----------------------------------------
code_block = CodeBlock { "Comments"; }
faces = Element.Faces(element=filter1)
round_Names = Python(IN[0]=filter1, IN[1]=faces)  # IronPython2
# ---------- round_Names.python (159 lines) ----------
import clr
import math

clr.AddReference('RevitAPI')
from Autodesk.Revit.DB import *

clr.AddReference('RevitAPIUI')
from Autodesk.Revit.UI import *

clr.AddReference('System')
from System.Collections.Generic import List

clr.AddReference('RevitNodes')
import Revit
clr.ImportExtensions(Revit.GeometryConversion)
clr.ImportExtensions(Revit.Elements)

clr.AddReference('RevitServices')
import RevitServices
from RevitServices.Persistence import DocumentManager
from RevitServices.Transactions import TransactionManager

doc = DocumentManager.Instance.CurrentDBDocument
uidoc = DocumentManager.Instance.CurrentUIApplication.ActiveUIDocument

#tìm 3 diện tích mặt lớn nhất và index của nó
def find_largest_numbers(numbers):
    if len(numbers) < 2:
        raise ValueError("Danh sách phải có ít nhất 2 số")

    largest = second_largest = float('-inf')
    index1 = index2 = -1

    for i, number_ in enumerate(numbers):
    	number = round_to_nearest_number(number_)
        if number > largest:
            second_largest = largest
            largest = number
            index2 = index1
            index1 = i
        elif number > second_largest and number != largest:
            second_largest = number
            index2 = i
    return largest, second_largest, index1, index2

#làm tròn thành size của ống tròn
def find_closest_size(size):
    min_diff = float('inf')  # Khởi tạo giá trị min_diff lớn vô cực
    closest_size = size  # Khởi tạo kích thước gần nhất là giá trị tính toán ban đầu
    for round_size in round_sizes:
        diff = abs(round_size - size)
        if diff < min_diff:
            min_diff = diff
            closest_size = round_size
    return closest_size

def round_to_nearest_number(number):
    if number < 50000:
        return round(number / 1000) * 1000
    elif 50000 <= number < 100000:
        return round(number / 2000) * 2000
    elif 100000 <= number < 250000:
        return round(number / 5000) * 5000
    elif 250000 <= number < 510000:
        return round(number / 10000) * 10000
    elif 510000 <= number < 1000000:
        return round(number / 20000) * 20000
    else:
        return round(number / 30000) * 30000

def round_to_nearest_2000(number):
    return round(number / 2000) * 2000

#SO sanh 2 so tuong duong trong khoang 1%
def are_numbers_equal_within_1_percent(num1, num2):
    # Tính giá trị trung bình của hai số
    avg = (num1 + num2) / 2.0
    
    # Kiểm tra sự chênh lệch có nằm trong khoảng 1% hay không
    return abs(num1 - num2) <= 0.01 * avg

def is_round_bending(fitting_type):
    for round_bending_name in round_bending_names:
        if round_bending_name in fitting_type:
            return True
    return False

def is_round_tee(fitting_type):
    for round_tee_name in round_tee_names:
        if round_tee_name in fitting_type:
            return True
    return False

def is_round_transition(fitting_type):
    for round_transition_name in round_transition_names:
        if round_transition_name in fitting_type:
            return True
    return False

elements = IN[0]
elements_Surfaces = IN[1]

#out result
sizes = []

#data cua round duct
round_sizes = [100, 125, 160, 200, 250, 315, 355, 400, 450, 500, 560, 630, 710, 800, 1000, 1120, 1250]
round_bending_names = ["BU:BU","BKU:BKU","BFU:BFU","BKFU:BKFU"]
round_tee_names = ["TCPU:TCPU","TCU:TCU"]
round_transition_names = ["RCLU:RCLU","RCU:RCU"]
     
for i,element in enumerate(elements):
    fitting_type = element.GetParameterValueByName("ObjectTypeOverride")
    faces = elements_Surfaces[i]
    if faces is not None:#Kiem tra doi tuong co face khong
        areas = []
        for face in faces:
            area = face.Area
            areas.append(area)

        if is_round_bending(fitting_type):
            largest_area, second_largest_area, index1, index2 = find_largest_numbers(areas)
            
            size_largest = math.sqrt(largest_area * 4 / 3.14) 
            closest_size_largest = find_closest_size(size_largest)

            sizes.append("Ø" + str(int(closest_size_largest)))

        elif is_round_transition(fitting_type):   
            largest_area, second_largest_area, index1, index2 = find_largest_numbers(areas)
            
            size_largest = math.sqrt(largest_area * 4 / 3.14) 
            size_second_largest = math.sqrt(second_largest_area * 4 / 3.14) 
            closest_size_largest = find_closest_size(size_largest)
            closest_size_second_largest = find_closest_size(size_second_largest)

            sizes.append("Ø" + str(int(closest_size_largest)) + "-Ø" + str(int(closest_size_second_largest)))

        elif is_round_tee(fitting_type):   
            largest_area, second_largest_area, index1, index2 = find_largest_numbers(areas)
            
            size_largest = math.sqrt(largest_area * 4 / 3.14) 
            closest_size_largest = find_closest_size(size_largest)

            sizes.append("Ø" + str(int(closest_size_largest)) + "-Ø" + str(int(closest_size_largest)) + "-Ø" + str(int(closest_size_largest)))
           
        elif "ILRU:ILRU" in fitting_type:
            largest_area, second_largest_area, index1, index2 = find_largest_numbers(areas)

            size_largest = math.sqrt(largest_area * 4 / 3.14) 
            closest_size_largest = find_closest_size(size_largest)

            sizes.append("Ø" + str(int(closest_size_largest)))

        else:
            sizes.append("Not found")
    else:
        sizes.append("Not found")
OUT = sizes
# ----------------------------------------
setParameterByName = Element.SetParameterByName(element=filter1, parameterName=code_block, value=round_Names)
filter2 = Python(IN[0]=select_model_elements_by)  # IronPython2
# ---------- filter2.python (38 lines) ----------
import clr
import math

clr.AddReference('RevitAPI')
from Autodesk.Revit.DB import *

clr.AddReference('RevitAPIUI')
from Autodesk.Revit.UI import *

clr.AddReference('System')
from System.Collections.Generic import List

clr.AddReference('RevitNodes')
import Revit
clr.ImportExtensions(Revit.GeometryConversion)
clr.ImportExtensions(Revit.Elements)

clr.AddReference('RevitServices')
import RevitServices
from RevitServices.Persistence import DocumentManager
from RevitServices.Transactions import TransactionManager

doc = DocumentManager.Instance.CurrentDBDocument
uidoc = DocumentManager.Instance.CurrentUIApplication.ActiveUIDocument

elements = IN[0]
element_s = []
name_LDR = "LDR:LDR"
name_LORU = "LORU:LORU"
name_LBXR = "LBXR:LBXR"
name_LBR = "LBR:LBR"
name_LEPR = "LEPR:LEPR"

for i,element in enumerate(elements):
    fitting_type = element.GetParameterValueByName("ObjectTypeOverride")
    if name_LDR in fitting_type or name_LORU in fitting_type or name_LBXR in fitting_type or name_LBR in fitting_type or name_LEPR in fitting_type:
    	element_s.append(element)
OUT = element_s
# ----------------------------------------
code_block_2 = CodeBlock { "Comments"; }
faces_2 = Element.Faces(element=filter2)
perimeterCurves = Surface.PerimeterCurves(surface=faces_2)
rectangular_Names = Python(IN[0]=filter2, IN[1]=faces_2, IN[2]=perimeterCurves)  # IronPython2
# ---------- rectangular_Names.python (206 lines) ----------
import clr
import math

clr.AddReference('RevitAPI')
from Autodesk.Revit.DB import *

clr.AddReference('RevitAPIUI')
from Autodesk.Revit.UI import *

clr.AddReference('System')
from System.Collections.Generic import List

clr.AddReference('RevitNodes')
import Revit
clr.ImportExtensions(Revit.GeometryConversion)
clr.ImportExtensions(Revit.Elements)

clr.AddReference('RevitServices')
import RevitServices
from RevitServices.Persistence import DocumentManager
from RevitServices.Transactions import TransactionManager

doc = DocumentManager.Instance.CurrentDBDocument
uidoc = DocumentManager.Instance.CurrentUIApplication.ActiveUIDocument

# Data của round duct
round_sizes = [100, 125, 160, 200, 250, 315, 355, 400, 450, 500, 560, 630, 710, 800, 1000, 1120, 1250]

# Tìm 3 diện tích mặt lớn nhất và index của nó
def find_three_largest_numbers(numbers):
    if len(numbers) < 3:
        raise ValueError("Danh sách phải có ít nhất 3 số")

    largest = second_largest = third_largest = float('-inf')
    index1 = index2 = -1

    for i, number_ in enumerate(numbers):
        number = round_to_nearest_5000(number_)
        if number > largest:
            third_largest = second_largest
            second_largest = largest
            largest = number
            index2 = index1
            index1 = i
        elif number > second_largest and number != largest:
            third_largest = second_largest
            second_largest = number
            index2 = i
        elif number > third_largest and number != largest and number != second_largest:
            third_largest = number
    return largest, second_largest, third_largest, index1, index2

# Làm tròn thành size của ống tròn
def find_closest_size(size):
    min_diff = float('inf')
    closest_size = size
    for round_size in round_sizes:
        diff = abs(round_size - size)
        if diff < min_diff:
            min_diff = diff
            closest_size = round_size
    return closest_size

# Làm tròn 1 số theo 50
def round_to_nearest_50(number):
    return round(number / 50) * 50

# Làm tròn 1 số theo 5000
def round_to_nearest_5000(number):
    return round(number / 5000) * 5000

# Function to check if a face contains any arc curves
def face_contains_specific_curve(curves, type_curve):
    for curve in curves:
        if curve.GetType().Name == type_curve:
            return True
    return False

# Function to find the largest face that does not contain any arc curves 
def find_largest_non_arc_face(areas, curves, type_curve):
    largest_area = second_area = 0
    
    for i, area_ in enumerate(areas):
        area = round_to_nearest_5000(area_)
        if not face_contains_specific_curve(curves[i], type_curve):
            if area > largest_area:
                largest_area = area
                index_largest = i
            elif area > second_area and area != largest_area:
                second_area = area
                index_second = i
            elif area == largest_area:
                index_second = i
    
    return index_largest, index_second

elements = IN[0]
elements_surfaces = IN[1]
elements_curses = IN[2]

# Đầu vào
sizes = []
name_LDR = "LDR:LDR"
name_LORU = "LORU:LORU"
name_LBXR = "LBXR:LBXR"
name_LBR = "LBR:LBR"
name_LEPR = "LEPR:LEPR"

for i, element in enumerate(elements):
    fitting_type = element.GetParameterValueByName("ObjectTypeOverride")
    faces = elements_surfaces[i]
    if faces is not None:
        areas = []
        for face in faces:
            area = face.Area
            areas.append(area)
            
        if name_LDR in fitting_type:
            largest_area, second_largest_area, third_largest_area, index1, index2 = find_three_largest_numbers(areas)
            
            Length1 = round_to_nearest_50(elements_curses[i][index1][0].Length)
            Length2 = round_to_nearest_50(elements_curses[i][index1][1].Length)
            Length3 = round_to_nearest_50(elements_curses[i][index2][0].Length)
            Length4 = round_to_nearest_50(elements_curses[i][index2][1].Length)
            
            if Length1 > Length2:
                Length1_ = Length1
                Length2_ = Length2
            else:
                Length1_ = Length2
                Length2_ = Length1

            if Length3 > Length4:
                Length3_ = Length3
                Length4_ = Length4
            else:
                Length3_ = Length4
                Length4_ = Length3

            size = str(int(Length1_)) + "x" + str(int(Length2_)) + "-" + str(int(Length3_)) + "x" + str(int(Length4_))
            sizes.append(size)
        #LORU giải thuật là tìm 2 mặt có diện tích lớn nhất và nhì rồi lấy curve Line và Circle của mặt để lấy kích thước
        elif name_LORU in fitting_type:
            largest_area, second_largest_area, third_largest_area, index1, index2 = find_three_largest_numbers(areas)
            
            type_curse_largest = elements_curses[i][index1][0].GetType().Name
            type_curse_second = elements_curses[i][index2][0].GetType().Name
            if type_curse_largest == "Line" and type_curse_second == "Circle":
                Length1 = round_to_nearest_50(elements_curses[i][index1][0].Length)
                Length2 = round_to_nearest_50(elements_curses[i][index1][1].Length)
                if Length1 > Length2:
                    Length1_ = Length1
                    Length2_ = Length2
                else:
                    Length1_ = Length2
                    Length2_ = Length1
                round_size = find_closest_size(elements_curses[i][index2][0].Radius*2)
                size = str(int(Length1_)) + "x" + str(int(Length2_)) + "-Ø" + str(int(round_size))
            elif type_curse_largest == "Circle" and type_curse_second == "Line":
                Length1 = round_to_nearest_50(elements_curses[i][index2][0].Length)
                Length2 = round_to_nearest_50(elements_curses[i][index2][1].Length)
                round_size = find_closest_size(elements_curses[i][index1][0].Radius*2)
                if Length1 > Length2:
                    Length1_ = Length1
                    Length2_ = Length2
                else:
                    Length1_ = Length2
                    Length2_ = Length1
                size = str(int(Length1_)) + "x" + str(int(Length2_)) + "-Ø" + str(int(round_size))
            else:
                size = "Unknown"
            sizes.append(size)
        
        #LBXR giải thuật là tìm mặt ko chứa curve arc và có diện tích lớn nhất
        elif name_LBXR in fitting_type:
            index_largest, index_second = find_largest_non_arc_face(areas, elements_curses[i], "Arc")
            Length1 = round_to_nearest_50(elements_curses[i][index_largest][0].Length)
            Length2 = round_to_nearest_50(elements_curses[i][index_largest][1].Length)
            size = str(int(Length1)) + "x" + str(int(Length2)) + "-" + str(int(Length1)) + "x" + str(int(Length2))
            sizes.append(size)
        #LBR giải thuật là tìm mặt ko chứa curve arc và có diện tích lớn nhì
        elif name_LBR in fitting_type:
            index_largest, index_second = find_largest_non_arc_face(areas, elements_curses[i], "Arc")
            Length1 = round_to_nearest_50(elements_curses[i][index_second][0].Length)
            Length2 = round_to_nearest_50(elements_curses[i][index_second][1].Length)
            size = str(int(Length1)) + "x" + str(int(Length2)) + "-" + str(int(Length1)) + "x" + str(int(Length2))
            sizes.append(size)
        elif name_LEPR in fitting_type:
            index_largest, index_second = find_largest_non_arc_face(areas, elements_curses[i], "Arc")
            Length1 = round_to_nearest_50(elements_curses[i][index_largest][0].Length)
            Length2 = round_to_nearest_50(elements_curses[i][index_largest][1].Length)
            if Length1 > Length2:
                Length1_ = Length1
                Length2_ = Length2
            else:
                Length1_ = Length2
                Length2_ = Length1
            size = str(int(Length1_)) + "x" + str(int(Length2_)) + "-" + str(int(Length1_)) + "x" + str(int(Length2_))
            sizes.append(size)

        else:
            sizes.append("Not found")
    else:
        sizes.append("Not found")

OUT = sizes
# ----------------------------------------
setParameterByName_2 = Element.SetParameterByName(element=filter2, parameterName=code_block_2, value=rectangular_Names)
area = Surface.Area(surface=faces)
