# Dynamo graph Tìm size duct.dyn (Dynamo 2.12.0.5650)

select_model_elements_by = DSModelElementsByCategorySelection(index=207)  # "Select Model Elements By Category"; 2 picked in the model
code_block = CodeBlock { "Comments"; }
faces = Element.Faces(element=select_model_elements_by)
code_block_2 = CodeBlock { 0.5; }
pointAtParameter = Surface.PointAtParameter(surface=faces, u=code_block_2, v=code_block_2)
code_block_3 = CodeBlock { "Pset_FlowSegmentDuctSegment.Length"; }
getParameterValueByName = Element.GetParameterValueByName(element=select_model_elements_by, parameterName=code_block_3)
code_block_4 = CodeBlock { "Pset_DuctSegmentTypeCommon.Shape"; }
getParameterValueByName_2 = Element.GetParameterValueByName(element=select_model_elements_by, parameterName=code_block_4)
python_script = Python(IN[0]=pointAtParameter, IN[1]=getParameterValueByName, IN[2]=getParameterValueByName_2)  # IronPython2
# ---------- python_script.python (82 lines) ----------
import clr

import math

clr.AddReference('RevitAPI')
from Autodesk.Revit.DB import *
from Autodesk.Revit.DB.Structure import *

clr.AddReference('RevitAPIUI')
from Autodesk.Revit.UI import *

clr.AddReference('System')
from System.Collections.Generic import List

clr.AddReference('RevitNodes')
import Revit
clr.ImportExtensions(Revit.GeometryConversion)
clr.ImportExtensions(Revit.Elements)

clr.AddReference('RevitServices')
import RevitServices
from RevitServices.Persistence import DocumentManager
from RevitServices.Transactions import TransactionManager

doc = DocumentManager.Instance.CurrentDBDocument
uidoc=DocumentManager.Instance.CurrentUIApplication.ActiveUIDocument

elements_points = IN[0]
elements_length = IN[1]
elements_shape = IN[2]

def is_close(a,b):
	return abs(a - b) < 0.1

elements_vectors_length = []

def round_to_nearest_10(number):
    return round(number / 10) * 10

for i in range(0,len(elements_length)):
    if elements_shape[i] != "ROUND":
        pointA = elements_points[i][0]
        pointB = elements_points[i][1]
        pointC = elements_points[i][2]
        pointD = elements_points[i][3]
        pointE = elements_points[i][4]
        pointF = elements_points[i][5]

        length1 = round_to_nearest_10(math.sqrt((pointB.X - pointA.X)**2 + (pointB.Y - pointA.Y)**2 + (pointB.Z - pointA.Z)**2))
        length2 = round_to_nearest_10(math.sqrt((pointE.X - pointC.X)**2 + (pointE.Y - pointC.Y)**2 + (pointE.Z - pointC.Z)**2))
        length3 = round_to_nearest_10(math.sqrt((pointF.X - pointD.X)**2 + (pointF.Y - pointD.Y)**2 + (pointF.Z - pointD.Z)**2))
        
        duct_vectors = []
        if is_close(length1, elements_length[i]):
            if length2>length3:
                size = str(int(length2)) + "x" + str(int(length3))
            else:
                size = str(int(length3)) + "x" + str(int(length2))
        elif is_close(length2, elements_length[i]):
            if length1>length3:
                size = str(int(length1)) + "x" + str(int(length3))
            else:
                size = str(int(length3)) + "x" + str(int(length1))
        elif is_close(length3, elements_length[i]):
            if length1>length2:
                size = str(int(length1)) + "x" + str(int(length2))
            else:
                size = str(int(length2)) + "x" + str(int(length1))
        
        elements_vectors_length.append(size)

    else:
        pointA = elements_points[i][2]
        pointB = elements_points[i][3]

        length1 = math.sqrt((pointB.X - pointA.X)**2 + (pointB.Y - pointA.Y)**2 + (pointB.Z - pointA.Z)**2)

        size = "Ø" + str(int(round(length1)))

        elements_vectors_length.append(size)

OUT = elements_vectors_length
# ----------------------------------------
setParameterByName = Element.SetParameterByName(element=select_model_elements_by, parameterName=code_block, value=python_script)
