# Dynamo graph Tổng diện tích bề mặt nhiều đối tượng.dyn (Dynamo 2.12.0.5650)

select_model_elements_by = DSModelElementsByCategorySelection(index=266)  # "Select Model Elements By Category"; 62 picked in the model
code_block = CodeBlock { "Area Insulation"; }
faces = Element.Faces(element=select_model_elements_by)
python_script = Python(IN[0]=faces)  # IronPython2
# ---------- python_script.python (40 lines) ----------
import clr

clr.AddReference('RevitAPI')
from Autodesk.Revit.DB import *
from Autodesk.Revit.DB.Structure import *

clr.AddReference('RevitAPIUI')
from Autodesk.Revit.UI import *

clr.AddReference('System')
from System.Collections.Generic import List

clr.AddReference('RevitNodes')
import Revit
clr.ImportExtensions(Revit.GeometryConversion)
clr.ImportExtensions(Revit.Elements)

clr.AddReference('RevitServices')
import RevitServices
from RevitServices.Persistence import DocumentManager
from RevitServices.Transactions import TransactionManager

doc = DocumentManager.Instance.CurrentDBDocument
uidoc=DocumentManager.Instance.CurrentUIApplication.ActiveUIDocument

# Lấy danh sách diện tích các bề mặt từ Dynamo
elements_surfaces = IN[0]

# Khởi tạo biến để lưu trữ tổng diện tích
elements_total_area = []

# Lặp qua các diện tích và tính tổng diện tích
for element_surfaces in elements_surfaces:
	total_area = 0
	for surf in element_surfaces:
		total_area += surf.Area
	elements_total_area.append(total_area/1000000)
    	
# Trả về tổng diện tích (m2)
OUT = elements_total_area
# ----------------------------------------
setParameterByName = Element.SetParameterByName(element=select_model_elements_by, parameterName=code_block, value=python_script)
