# Dynamo graph Vertical ducts - Skakt.dyn "Hide vertica ducts - Skakt" (Dynamo 2.16.2.5624)
# packages: spring nodes 210.1.1, Clockwork for Dynamo 2.x 2.12.2, MEPover 2024.9.25

categories = Categories("OST_DuctInsulations")
current = Document.Current()
ꟿ_document_activeview = Custom[ꟿ Document.ActiveView](refresh=current)  # package spring nodes; Selects the current document's active view. Supports more view types than the built-in option. Will be depreciated once the bult in node works with all plan types.
all_elements_of_category_in_view = ElementsOfCategoryInView(Category=categories, View=ꟿ_document_activeview)
categories_2 = Categories("OST_DuctCurves")
all_elements_of_category_in_view_2 = ElementsOfCategoryInView(Category=categories_2, View=ꟿ_document_activeview)

# group: Filter Ducts
location = Custom[Element.Location+](element=all_elements_of_category_in_view_2)  # package Clockwork for Dynamo 2.x; Returns the location of an element as point, curve or curve loop, along with some booleans to help filtering the results. Unlike the OOTB Element.GetLocation node, it also returns sketch lines of sketch-based elements like floor slabs as well as the element's rotation property. Additionally, it supports quite a few more element types (e.g. railings, stairs etc.).
endPoint = Curve.EndPoint(curve=location.curves)
X = Point.X(point=endPoint)
Y = Point.Y(point=endPoint)
byCoordinates = Point.ByCoordinates(x=X, y=Y)
string_from_object = FromObject(object=byCoordinates)
startPoint = Curve.StartPoint(curve=location.curves)
X_2 = Point.X(point=startPoint)
Y_2 = Point.Y(point=startPoint)
byCoordinates_2 = Point.ByCoordinates(x=X_2, y=Y_2)
string_from_object_2 = FromObject(object=byCoordinates_2)
contains = List.Contains(list=string_from_object, item=string_from_object_2, lacing=Longest)
filterByBoolMask = List.FilterByBoolMask(list=all_elements_of_category_in_view_2, mask=contains)

categories_3 = Categories("OST_DuctFitting")
all_elements_of_category_in_view_3 = ElementsOfCategoryInView(Category=categories_3, View=ꟿ_document_activeview)
categories_4 = Categories("OST_DuctAccessory")
all_elements_of_category_in_view_4 = ElementsOfCategoryInView(Category=categories_4, View=ꟿ_document_activeview)

# group: Filter Insulation Ducts
list_create = List.Create(item0=filterByBoolMask.out, item1=all_elements_of_category_in_view_3, item2=all_elements_of_category_in_view_4)
mep_connector_info = Custom[MEP connector info](element=list_create@L2, lacing=Longest)  # package MEPover; Returns location, connector info and connected elements
string_from_object_3 = FromObject(object=mep_connector_info.ConnectedElements)
code_block = CodeBlock { "DuctInsulation"; }
eq = string_from_object_3@L2 == code_block
filterByBoolMask_2 = List.FilterByBoolMask(list=mep_connector_info.ConnectedElements@L2, mask=eq@L2)
flatten = List.Flatten(list=filterByBoolMask_2.in)

# group: Review
list_create_2 = List.Create(item0=filterByBoolMask.out, item1=all_elements_of_category_in_view_3, item2=all_elements_of_category_in_view_4, item3=flatten)
flatten_2 = List.Flatten(list=list_create_2)
overridesInView = Element.OverridesInView(element=flatten_2, lacing=Longest)
boolean = BoolSelector(true)  # graph input
overrideInView = Element.OverrideInView(element=flatten_2, overrides=overridesInView, hide=boolean, lacing=Longest)
